# Grasshopper definition MascaraCovid19Poli.gh (Grasshopper 1.0.7)

radius_3 = Slider(14.5, range=10..40)
number_slider = Slider(28, range=10..40)
ellipse = Ellipse(Plane=PlaneXY(0, 0, 0), Radius1=Slider(8.5, range=5..15), Radius2=Slider(7.2, range=5..30))  # -> Ellipse, Focus1, Focus2
ellipse_2 = Ellipse(Plane=PlaneXY(0, 0, 0), Radius1=Slider(48, range=20..50), Radius2=number_slider)  # -> Ellipse, Focus1, Focus2
division = Division(A=radius_3, B=number_slider)
Z = UnitZ(Factor=number_slider)
ln = Line(StartPoint=ellipse_2.Focus1, EndPoint=ellipse_2.Focus2)
pt = Point(Point(0, 0, 0))
ext = ExtendCurve(Curve=ln, Type=0, Start="10", End="10")
multiplication = Multiplication(A=Z, B=1.5)
Y = UnitY(Factor=1)
ccx = CurveCurve(CurveA=ellipse_2.Ellipse, CurveB=ext)  # -> Points, ParamsA, ParamsB
panel = Panel("Pi")
line = LineSDL(Start=pt, Direction=Y, Length=1)
extr = Extrude(Base=ellipse.Ellipse, Direction=multiplication)
shatter = Shatter(Curve=ellipse_2.Ellipse, Parameters=ccx.ParamsA)
rotax = RotateAxis(Geometry=extr, Angle=degrees(Slider(45, range=0..45)), Axis=line)  # -> Geometry, Transform
item = ListItem(List=shatter, Index=0, Wrap=True)
revsrf = Revolution(Curve=item, Axis=ln, Domain=Domain(0, 6.283185307))
scale_nu = ScaleNU(Geometry=revsrf, Plane=PlaneXY(0, 0, 0), ScaleX=1, ScaleY=division, ScaleZ=1)  # -> Geometry, Transform
split = SplitBrep(Brep=scale_nu.Geometry, Cutter=rotax.Geometry)  # -> reverse(Result)
area = Area(Geometry=split)  # -> Area, Centroid
sort = SortList(Keys=area.Area, ValuesA=split, ValuesB=area.Centroid)  # -> Keys, ValuesA, ValuesB
item_2 = ListItem(List=sort.ValuesA, Index=0, Wrap=True)
item_3 = ListItem(List=sort.ValuesB, Index=0, Wrap=True)
xz = XZPlane(Origin=Point(0, 0, 0))
preview = CustomPreview(
    Geometry=item_2,
    Material={diffuse=RGB(221, 160, 221), emission=RGB(66, 48, 66), shine=0.5, specular=RGB(255, 255, 255), transparency=0})
sec = BrepPlane(Brep=item_2, Plane=xz)  # -> Curves, Points
len = Length(Curve=sec.Curves)
panel_2 = Panel(len)
project = Project(Geometry=sec.Curves, Plane=PlaneXY(0, 0, 0))  # -> Geometry, Transform
pframes = PerpFrames(Curve=project.Geometry, Count="100", Align=True)  # -> Frames, Parameters
sec_2 = BrepPlane(Brep=item_2, Plane=pframes.Frames)  # -> flatten(Curves), Points
len_2 = Length(Curve=sec_2.Curves)
sort_2 = SortList(Keys=len_2, ValuesA=sec_2.Curves)  # -> reverse(Keys), reverse(ValuesA)
item_4 = ListItem(List=sort_2.Keys, Index=0, Wrap=True)
panel_3 = Panel(item_4)
item_5 = ListItem(List=sort_2.ValuesA, Index=0, Wrap=True)
